vi "index.gviweb"   [LabVIEW NXG 5.1.0]
panel controls:
  "input 0": f64
panel indicators:
  "Chart": f64
diagram:
  # Place setup code before the loop. For example, perform initial data communication and wire the results into the loop.
  # Top-Level WebVIs usually contain a While Loop that never stops so that they can continue running as long as the web page is open in the user's web browser.
  while {
    Random Number() -> (number (0 to 1)=w1)
    Multiply($"input 0", w1) -> w2
    $Chart <- w2
    Wait(time to wait=50)
    stop if FALSE
  }
